# Grasshopper definition DG_RTP_Maeda.gh (Grasshopper 1.0.7)

animation_slider = Slider(514, range=0..514)
sa = Curve(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)
wa = Curve(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)
ri = Curve([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])
mo = Curve(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)
item = ListItem(List=ri, Index=0, Wrap=True)
item_2 = ListItem(List=ri, Index=1, Wrap=True)

# ---- group: Aspect Ratio
rectangle = Rectangle(Plane=PlaneXY(0, 0, 0), XSize=Slider(800, range=0..1000), YSize=Slider(1200, range=0..1200), Radius=0)  # -> Rectangle, Length
crv = Curve(rectangle.Rectangle)

# ---- group: Correct Center
area = Area(Geometry=item)  # -> Area, Centroid
vec = VectorXYZ(XComponent=Slider(-43.35, range=-50..50), YComponent=Slider(-7.09, range=-50..50), ZComponent=0)  # -> Vector, Length
move = Move(Geometry=area.Centroid, Motion=vec.Vector)  # -> Geometry, Transform

# ---- group: Character Preview Black
boundary = BoundarySurfaces(Edges=sa)
Z = UnitZ(Factor=400)
move_2 = Move(Geometry=boundary, Motion=Z)  # -> Geometry, Transform
preview = CustomPreview(Geometry=move_2.Geometry, Material=ColourSwatch(SwatchColor=RGB(0, 0, 0)))

# ---- group: Correct Center
area_2 = Area(Geometry=sa)  # -> Area, Centroid
vec_2 = VectorXYZ(XComponent=Slider(-8.02, range=-50..80), YComponent=Slider(-7.09, range=-50..50), ZComponent=0)  # -> Vector, Length
move_3 = Move(Geometry=area_2.Centroid, Motion=vec_2.Vector)  # -> Geometry, Transform

# ---- group: Character Preview Black
boundary_2 = BoundarySurfaces(Edges=ri)
Z_2 = UnitZ(Factor=100)
swatch = ColourSwatch(SwatchColor=RGB(0, 0, 0))
move_4 = Move(Geometry=boundary_2, Motion=Z_2)  # -> Geometry, Transform
preview_2 = CustomPreview(Geometry=move_4.Geometry, Material=swatch)

# ----
series = Series(Start=0, Step=Slider(2.006, range=0..7.5), Count=Slider(515, range=0..2000))
neg = Negative(Value=series)
Y = UnitY(Factor=neg)
move_5 = Move(Geometry=item, Motion=Y)  # -> Geometry, Transform
move_6 = Move(Geometry=move.Geometry, Motion=Y)  # -> Geometry, Transform
Y_2 = UnitY(Factor=move_6.Geometry)
lng = ListLength(List=move_5.Geometry)
multiplication = Multiplication(A=Slider(180, range=0..180), B=Slider(5.994, range=0..7))
subtraction = Subtraction(A=lng, B=1)
dom = ConstructDomain(DomainStart=Slider(1, range=0..1), DomainEnd=Slider(0.0001, range=0.0001..1))
dom_2 = ConstructDomain(DomainStart=Slider(0, range=0..180), DomainEnd=multiplication)
range = Range(Domain=dom, Steps=subtraction)
range_2 = Range(Domain=dom_2, Steps=subtraction)
rad = Radians(Degrees=range_2)
rot3d = Rotate3D(Geometry=move_5.Geometry, Angle=rad, Center=move_6.Geometry, Axis=Y_2)  # -> Geometry, Transform
scale = Scale(Geometry=rot3d.Geometry, Center=move_6.Geometry, Factor=range)  # -> Geometry, Transform
crv_2 = Curve(scale.Geometry)

series_2 = Series(Start=0, Step=Slider(2.006, range=0..7.5), Count=Slider(515, range=0..2000))
neg_2 = Negative(Value=series_2)
Y_3 = UnitY(Factor=neg_2)
move_7 = Move(Geometry=sa, Motion=Y_3)  # -> Geometry, Transform
move_8 = Move(Geometry=move_3.Geometry, Motion=Y_3)  # -> Geometry, Transform
Y_4 = UnitY(Factor=move_8.Geometry)
lng_2 = ListLength(List=move_7.Geometry)
multiplication_2 = Multiplication(A=Slider(180, range=0..180), B=Slider(5.994, range=0..7))
subtraction_2 = Subtraction(A=lng_2, B=1)
dom_3 = ConstructDomain(DomainStart=Slider(1, range=0..1), DomainEnd=Slider(0.0001, range=0.0001..1))
dom_4 = ConstructDomain(DomainStart=Slider(0, range=0..180), DomainEnd=multiplication_2)
range_3 = Range(Domain=dom_3, Steps=subtraction_2)
range_4 = Range(Domain=dom_4, Steps=subtraction_2)
rad_2 = Radians(Degrees=range_4)
rot3d_2 = Rotate3D(Geometry=move_7.Geometry, Angle=rad_2, Center=move_8.Geometry, Axis=Y_4)  # -> Geometry, Transform
scale_2 = Scale(Geometry=rot3d_2.Geometry, Center=move_8.Geometry, Factor=range_3)  # -> Geometry, Transform
crv_3 = Curve(scale_2.Geometry)

# ---- group: Character Preview Black
boundary_3 = BoundarySurfaces(Edges=wa)
Z_3 = UnitZ(Factor=400)
move_9 = Move(Geometry=boundary_3, Motion=Z_3)  # -> Geometry, Transform
preview_3 = CustomPreview(Geometry=move_9.Geometry, Material=ColourSwatch(SwatchColor=RGB(0, 0, 0)))

# ---- group: Correct Center
area_3 = Area(Geometry=wa)  # -> Area, Centroid
vec_3 = VectorXYZ(XComponent=Slider(-8.02, range=-50..80), YComponent=Slider(-7.09, range=-50..50), ZComponent=0)  # -> Vector, Length
move_10 = Move(Geometry=area_3.Centroid, Motion=vec_3.Vector)  # -> Geometry, Transform

# ---- group: Character Preview Black
boundary_4 = BoundarySurfaces(Edges=item_2)
Z_4 = UnitZ(Factor=100)
move_11 = Move(Geometry=boundary_4, Motion=Z_4)  # -> Geometry, Transform
preview_4 = CustomPreview(Geometry=move_11.Geometry, Material=ColourSwatch(SwatchColor=RGB(0, 0, 0)))

# ---- group: Correct Center
area_4 = Area(Geometry=item_2)  # -> Area, Centroid
vec_4 = VectorXYZ(XComponent=Slider(57.46, range=-50..80), YComponent=Slider(-7.09, range=-50..50), ZComponent=0)  # -> Vector, Length
move_12 = Move(Geometry=area_4.Centroid, Motion=vec_4.Vector)  # -> Geometry, Transform

# ----
series_3 = Series(Start=0, Step=Slider(2.006, range=0..7.5), Count=Slider(515, range=0..2000))
neg_3 = Negative(Value=series_3)
Y_5 = UnitY(Factor=neg_3)
move_13 = Move(Geometry=wa, Motion=Y_5)  # -> Geometry, Transform
move_14 = Move(Geometry=move_10.Geometry, Motion=Y_5)  # -> Geometry, Transform
Y_6 = UnitY(Factor=move_14.Geometry)
lng_3 = ListLength(List=move_13.Geometry)
multiplication_3 = Multiplication(A=Slider(180, range=0..180), B=Slider(5.994, range=0..7))
subtraction_3 = Subtraction(A=lng_3, B=1)
dom_5 = ConstructDomain(DomainStart=Slider(1, range=0..1), DomainEnd=Slider(0.0001, range=0.0001..1))
dom_6 = ConstructDomain(DomainStart=Slider(0, range=0..180), DomainEnd=multiplication_3)
range_5 = Range(Domain=dom_5, Steps=subtraction_3)
range_6 = Range(Domain=dom_6, Steps=subtraction_3)
rad_3 = Radians(Degrees=range_6)
rot3d_3 = Rotate3D(Geometry=move_13.Geometry, Angle=rad_3, Center=move_14.Geometry, Axis=Y_6)  # -> Geometry, Transform
scale_3 = Scale(Geometry=rot3d_3.Geometry, Center=move_14.Geometry, Factor=range_5)  # -> Geometry, Transform
crv_4 = Curve(scale_3.Geometry)

series_4 = Series(Start=0, Step=Slider(2.006, range=0..7.5), Count=Slider(515, range=0..2000))
neg_4 = Negative(Value=series_4)
Y_7 = UnitY(Factor=neg_4)
move_15 = Move(Geometry=item_2, Motion=Y_7)  # -> Geometry, Transform
move_16 = Move(Geometry=move_12.Geometry, Motion=Y_7)  # -> Geometry, Transform
Y_8 = UnitY(Factor=move_16.Geometry)
lng_4 = ListLength(List=move_15.Geometry)
multiplication_4 = Multiplication(A=Slider(180, range=0..180), B=Slider(5.994, range=0..7))
subtraction_4 = Subtraction(A=lng_4, B=1)
dom_7 = ConstructDomain(DomainStart=Slider(1, range=0..1), DomainEnd=Slider(0.0001, range=0.0001..1))
dom_8 = ConstructDomain(DomainStart=Slider(0, range=0..180), DomainEnd=multiplication_4)
range_7 = Range(Domain=dom_7, Steps=subtraction_4)
range_8 = Range(Domain=dom_8, Steps=subtraction_4)
rad_4 = Radians(Degrees=range_8)
rot3d_4 = Rotate3D(Geometry=move_15.Geometry, Angle=rad_4, Center=move_16.Geometry, Axis=Y_8)  # -> Geometry, Transform
scale_4 = Scale(Geometry=rot3d_4.Geometry, Center=move_16.Geometry, Factor=range_7)  # -> Geometry, Transform
crv_5 = Curve(scale_4.Geometry)

# ---- group: Correct Center
area_5 = Area(Geometry=mo)  # -> Area, Centroid
vec_5 = VectorXYZ(XComponent=Slider(-5.84, range=-50..50), YComponent=Slider(-7.09, range=-50..50), ZComponent=0)  # -> Vector, Length
move_17 = Move(Geometry=area_5.Centroid, Motion=vec_5.Vector)  # -> Geometry, Transform

# ---- group: Character Preview Black
boundary_5 = BoundarySurfaces(Edges=mo)
Z_5 = UnitZ(Factor=100)
move_18 = Move(Geometry=boundary_5, Motion=Z_5)  # -> Geometry, Transform
preview_5 = CustomPreview(Geometry=move_18.Geometry, Material=ColourSwatch(SwatchColor=RGB(0, 0, 0)))

# ----
series_5 = Series(Start=0, Step=Slider(2.006, range=0..7.5), Count=Slider(515, range=0..2000))
neg_5 = Negative(Value=series_5)
Y_9 = UnitY(Factor=neg_5)
move_19 = Move(Geometry=mo, Motion=Y_9)  # -> Geometry, Transform
move_20 = Move(Geometry=move_17.Geometry, Motion=Y_9)  # -> Geometry, Transform
Y_10 = UnitY(Factor=move_20.Geometry)
lng_5 = ListLength(List=move_19.Geometry)
multiplication_5 = Multiplication(A=Slider(180, range=0..180), B=Slider(5.994, range=0..7))
subtraction_5 = Subtraction(A=lng_5, B=1)
dom_9 = ConstructDomain(DomainStart=Slider(1, range=0..1), DomainEnd=Slider(0.0001, range=0.0001..1))
dom_10 = ConstructDomain(DomainStart=Slider(0, range=0..180), DomainEnd=multiplication_5)
range_9 = Range(Domain=dom_9, Steps=subtraction_5)
range_10 = Range(Domain=dom_10, Steps=subtraction_5)
rad_5 = Radians(Degrees=range_10)
rot3d_5 = Rotate3D(Geometry=move_19.Geometry, Angle=rad_5, Center=move_20.Geometry, Axis=Y_10)  # -> Geometry, Transform
scale_5 = Scale(Geometry=rot3d_5.Geometry, Center=move_20.Geometry, Factor=range_9)  # -> Geometry, Transform
crv_6 = Curve(scale_5.Geometry)

# ---- group: Preview Final Characters
preview_6 = CustomPreview(Geometry=[move_18.Geometry, move_4.Geometry, move_11.Geometry, move_2.Geometry, move_9.Geometry], Material=swatch)

# ----
split = SplitList(List=reverse(crv_4), Index=animation_slider)  # -> ListA, ListB
split_2 = SplitList(List=reverse(crv_3), Index=animation_slider)  # -> ListA, ListB
split_3 = SplitList(List=reverse(crv_2), Index=animation_slider)  # -> ListA, ListB
split_4 = SplitList(List=reverse(crv_5), Index=animation_slider)  # -> ListA, ListB
split_5 = SplitList(List=reverse(crv_6), Index=animation_slider)  # -> ListA, ListB
crv_7 = Curve(split.ListA)
crv_8 = Curve(split_2.ListA)
crv_9 = Curve(split_3.ListA)
crv_10 = Curve(split_4.ListA)
crv_11 = Curve(split_5.ListA)
list = ValueList({"None": "", "Dot": "0.1 1.0", "Dash": "1.0", "DashDot": "1.0 1.0 0.1 1.0"}, selected="None")
curve_display = CSharpScript(
    Curve=[crv_11, crv_9, crv_10, crv_8, crv_7],
    Width=Slider(0.659, range=0..5),
    Colour=ColourSwatch(SwatchColor=RGB(105, 105, 105)),
    Dash=list)  # inputs Curve: Curve, Width: Int32, Colour: Color, Dash: String
# ---------- curve_display: C# usings ----------
using System.IO;
using System.Linq;
using System.Data;
using System.Drawing;
using System.Reflection;
using System.Windows.Forms;
using System.Xml;
using System.Xml.Linq;
using System.Runtime.InteropServices;

using Rhino.DocObjects;
using Rhino.Collections;
using GH_IO;
using GH_IO.Serialization;
# ---------- curve_display: C# ----------
    if (Curve == null) return;
    if (Width <= 0) return;

    double[] pattern = ParseDashPattern(Dash);
    IEnumerable<Curve> segments = ApplyDashPattern(Curve, pattern);

    _clip = BoundingBox.Union(_clip, Curve.GetBoundingBox(false));
    foreach (Curve segment in segments)
    {
      _curves.Add(segment);
      _colors.Add(Colour);
      _widths.Add(Width);
    }
# ---------- curve_display: C# additional code ----------
  /// <summary>
  /// Parse a dash pattern.
  /// </summary>
  /// <param name="pattern">Pattern to parse.</param>
  /// <returns>Array of dashes and gaps.</returns>
  private double[] ParseDashPattern(string pattern)
  {
    if (string.IsNullOrWhiteSpace(pattern))
      return null;

    string[] fragments = pattern.Split(new char[] {' '});
    if (fragments == null || fragments.Length == 0)
      return null;

    double[] values = new double[fragments.Length];
    for (int i = 0; i < fragments.Length; i++)
    {
      double v;
      if (!double.TryParse(fragments[i], out v))
        throw new Exception(fragments[i] + " is a not a valid number.");

      if (v <= 0.0)
        throw new Exception("Dashes or gaps must have a strictly positive length.");

      values[i] = v;
    }

    return values;
  }
  /// <summary>
  /// Apply a dash+gap pattern to a curve.
  /// </summary>
  private IEnumerable<Curve> ApplyDashPattern(Curve curve, double[] pattern)
  {
    if (pattern == null || pattern.Length == 0)
      return new Curve[] { curve };

    double curveLength = curve.GetLength();
    List<Curve> dashes = new List<Curve>();

    double offset0 = 0.0;
    int index = 0;
    while(true)
    {
      // Get the current dash length.
      double dashLength = pattern[index++];
      if (index >= pattern.Length)
        index = 0;

      // Compute the offset of the current dash from the curve start.
      double offset1 = offset0 + dashLength;
      if (offset1 > curveLength)
        offset1 = curveLength;

      // Solve the curve parameters at the current dash start and end.
      double t0, t1;
      curve.LengthParameter(offset0, out t0);
      curve.LengthParameter(offset1, out t1);

      Curve dash = curve.Trim(t0, t1);
      if (dash != null)
        dashes.Add(dash);

      // Get the current gap length.
      double gapLength = pattern[index++];
      if (index >= pattern.Length)
        index = 0;

      // Set the start of the next dash to be the end of the current
      // dash + the length of the adjacent gap.
      offset0 = offset1 + gapLength;

      // Abort when we've reached the end of the curve.
      if (offset0 >= curveLength)
        break;
    }

    return dashes;
  }

  private BoundingBox _clip;
  private readonly List<Curve> _curves = new List<Curve>();
  private readonly List<Color> _colors = new List<Color>();
  private readonly List<int> _widths = new List<int>();

  /// <summary>
  /// This method will be called once every solution, before any calls to RunScript.
  /// </summary>
  public override void BeforeRunScript()
  {
    _clip = BoundingBox.Empty;
    _curves.Clear();
    _colors.Clear();
    _widths.Clear();
  }

  /// <summary>
  /// Return a BoundingBox that contains all the geometry you are about to draw.
  /// </summary>
  public override BoundingBox ClippingBox
  {
    get { return _clip; }
  }
  /// <summary>
  /// Draw all wires and points in this method.
  /// </summary>
  public override void DrawViewportWires(IGH_PreviewArgs args)
  {
    for (int i = 0; i < _curves.Count; i++)
      args.Display.DrawCurve(_curves[i], _colors[i], _widths[i]);
  }
# ---------- end curve_display ----------
